# Grasshopper definition TestConnection.gh (Grasshopper 1.0.7)
# Copyright: 2021
# plug-ins: GrasshopperRadianceLinuxConnector, LadybugGrasshopper

# ----
# Connect
toggle = BooleanToggle(True)
connect_ssh = ConnectSSH(User="mss", Ip="127.0.0.1", Password="_prompt", _port=22, Connect=toggle)  # -> Status, Run
panel = Panel(connect_ssh.Status)

# ----
# Test connection
testconnection = TestConnection()  # -> Status, Errors
panel_2 = Panel(testconnection.Status)
panel_3 = Panel(testconnection.Errors)

win = Geometry([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])
floor = Geometry(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)
walls = Geometry(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)
# Grid
panel_4 = Panel("""Floors
Walls""")

panel_5 = Panel("""echo $PATH
genbox""")
falsestart = LBFalseStartToggle(False)
execute_ssh_async = ExecuteSSHAsync(SSHCommands=panel_5, Run=falsestart)  # -> Stdout, Stderr, Log, Pid, Ran
panel_6 = Panel(execute_ssh_async.Stderr)
panel_7 = Panel(execute_ssh_async.Stdout)

mesh = Mesh(win)
mesh_2 = Mesh(floor)
mesh_3 = Mesh(walls)
graft = GraftTree(Tree=panel_4, IncludeEmptyLists=True, IncludeNullItems=True)
concat = Concatenate(FragmentA="Windows", FragmentB="_mat")
entwine = Entwine(Branch00=mesh_2, Branch01=mesh_3, FlattenInputs=True)

# ----
# 5 phase bash script from andy mcneil
panel_8 = Panel("""#!/bin/bash

procs=4

### First let me download and unpacking Axel\'s files for rtcontrib lesson

printf "\nDownloading Axels rtcontrib lesson files...\n"
curl -O http://www.jaloxa.eu/resources/radiance/documentation/docs/rtcontrib_lesson.tgz
tar -xf rtcontrib_lesson.tgz
mv rtcontrib_lesson 5p_tutorial_examples

cd 5p_tutorial_examples

mkdir bsdf hourlypics hourlypics_dir hourlypics_ds hourlyresult \
	matrices octs viewpics viewpics_dir viewpics_ds
	
### Let me download the weather data file for you
printf "\nDownloading weather data...\n"
curl -O http://apps1.eere.energy.gov/buildings/energyplus/weatherdata/4_north_and_central_america_wmo_region_4/1_usa/USA_CA_Oakland.Intl.AP.724930_TMY3.zip
tar -xf USA_CA_Oakland.Intl.AP.724930_TMY3.zip
rm USA_CA_Oakland.Intl.AP.724930_TMY3.ddy 
rm USA_CA_Oakland.Intl.AP.724930_TMY3.stat
rm USA_CA_Oakland.Intl.AP.724930_TMY3.zip 
mv USA_CA_Oakland.Intl.AP.724930_TMY3.epw skies/.

# grabbing reinsrc.cal from CVS
printf "\nDownloading reinsrc.cal...\n"
curl -O http://radiance-online.org/cgi-bin/viewcvs.cgi/ray/src/cal/cal/reinsrc.cal

### Section 6.1 - Model adjustments for five-phase simulation
printf "\nMaking model adjustments...\n"
cat <<EOF > objects/testroom_Swall.rad
!genbox wall_mat wall_s_bottom 4 .3 1 |xform -t 0 -.3 0
!genbox wall_mat wall_s_top 4 .3 .5 |xform -t 0 -.3 2
!genbox wall_mat wall_s_west .5 .3 1 |xform -t 0 -.3 1
!genbox wall_mat wall_s_west .5 .3 1 |xform -t 3.5 -.3 1
EOF

cat <<EOF > objects/testroom.rad
!genbox floor_mat floor 4.6 6.6 .3 |xform -t -.3 -.3 -.3
!genbox ceiling_mat ceiling 4.6 6.6 .3 |xform -t -.3 -.3 2.5

!genbox wall_mat wall_w .3 6.6 2.5 |xform -t -.3 -.3 0
!genbox wall_mat wall_e .3 6.6 2.5 |xform -t 4 -.3 0
!genbox wall_mat wall_n 4 .3 2.5 |xform -t 0 6 0
EOF

cat <<EOF > objects/glazing.rad
void glass glazing
0
0
3 0.73 0.73 0.73

glazing polygon glass
0
0
12    0.5  -0.25   1
        0.5  -0.25   2
        3.5  -0.25   2
        3.5  -0.25   1
EOF

cat <<EOF > objects/venetianblind.rad
void plastic blindslat
0
0
5 .65 .65 .65 .01 0 

!genblinds blindslat blinds .05 3 1 25 0 +r .15 | xform -rz -90 -t 0.5 -.15 1 
EOF

cat <<EOF > objects/viewmtxsurf.rad
void glow viewsurf
0
0
4 1 1 1 0

viewsurf polygon inside
0
0
12    0.5   0   1
        0.5   0   2
        3.5   0   2
        3.5   0   1
EOF

cat <<EOF > objects/daymtxsurf.rad
void plastic daymtxsurf
0
0
5 0 0 0 0 0

daymtxsurf polygon outside
0
0
12    0.5   -0.3   1
        0.5   -0.3   2
        3.5   -0.3   2
        3.5   -0.3  1
EOF

cat <<EOF > objects/glazing_bsdf.rad
void BSDF BSDFproxy
6 0.30 bsdf/fullwindow_t45.xml 0 0 1 .
0
0

BSDFproxy polygon inside
0
0
12    0.5   0   1
        0.5   0   2
        3.5   0   2
        3.5   0   1
EOF

cat <<EOF >> materials/testroom.mat
void plastic black
0
0
5 0 0 0 0 0
EOF


### Section 6.2 - Creating BSDFs
xform -rz 180 -rx -90 -t 4 0 0 objects/glazing.rad objects/venetianblind.rad materials/testroom.mat \
	objects/testroom_Swall.rad > bsdf/fullwindow.rad

### I am going to save you the trouble of generating the High-Res BSDF
#genBSDF -n $procs +f +b -geom meter -dim 0.5 3.5 1 2 -.3 0 -t4 5 \
#	bsdf/fullwindow.rad > bsdf/fullwindow_t45.xml
printf "\nDownloading tensor tree BSDF...\n"
curl -o bsdf/fullwindow_t45.xml http://www.radiance-online.org/learning/tutorials/fivephasetutorialfiles/fullwindow_t45.xml

### I will also save you the trouble with the low-res BSDF
#bsdf2klems bsdf/fullwindow_t45.xml > bsdf/fullwindow_klems.xml
#genBSDF -n $procs +f +b -geom meter -dim 0.5 3.5 1 2 -.3 0 \
#	bsdf/fullwindow.rad > bsdf/fullwindow_klems.xml
printf "\nDownloading klems BSDF...\n"
curl -o bsdf/fullwindow.xml http://www.radiance-online.org/learning/tutorials/fivephasetutorialfiles/fullwindow.xml


### Section 6.3 - View matrix (V)
printf "\nDoing 5-phase simulation for sensor points...\n"
oconv materials/testroom.mat objects/daymtxsurf.rad objects/ground.rad objects/testroom.rad \
	objects/testroom_Swall.rad objects/viewmtxsurf.rad skies/sky_white.rad \
	objects/viewmtxsurf.rad objects/daymtxsurf.rad > octs/model_3ph.oct
printf "\nView Matrix\n"
time rcontrib < data/photocells.pts -n $procs -f klems_int.cal -b kbinS -bn Nkbins -m viewsurf \
	-I+ -ab 10 -ad 65536 -lw 1.52e-5 octs/model_3ph.oct > matrices/viewmatrix.vmx


### Section 6.4 - Direct view matrix (Vd)
printf "\nDirect View Matrix\n"
time rcontrib < data/photocells.pts -n $procs -f klems_int.cal -b kbinS -bn Nkbins -m viewsurf \
	-I+ -ab 1 -ad 65536 -lw 1.52e-5 octs/model_3ph.oct > matrices/viewmatrix_direct.vmx

### Section 6.5 - Daylight matrix (D)
printf "\nDaylight Matrix\n"
time genklemsamp -c 1000 -vd 0 -1 0 objects/daymtxsurf.rad | \
	rcontrib -n $procs -c 1000 -ab 2 -ad 1024 -e MF:1 -f reinhart.cal -b rbin -bn Nrbins \
		-m sky_glow octs/model_3ph.oct > matrices/daylightmatrix.dmx

### Section 6.6 - Direct daylight matrix (Dd)
printf "\nDirect Daylight Matrix\n"
xform -m black objects/testroom_Swall.rad objects/testroom.rad objects/ground.rad \
	objects/venetianblind.rad | oconv materials/testroom.mat - objects/viewmtxsurf.rad \
	objects/daymtxsurf.rad skies/sky_white.rad > octs/model_allblack.oct

time genklemsamp -c 1000 -vd 0 -1 0 objects/daymtxsurf.rad | \
	rcontrib -n $procs -c 1000 -ab 0 -e MF:1 -f reinhart.cal -b rbin -bn Nrbins \
		-m sky_glow octs/model_allblack.oct > matrices/daylightmatrix_direct.dmx

### Section 6.7 - Direct sun coefficient matrix (Cds)
printf "\nDirect Sun Coefficient Matrix\n"
echo void light solar 0 0 3 1e6 1e6 1e6 > skies/suns.rad
cnt 5185  |  rcalc -e MF:6 -f reinsrc.cal -e Rbin=recno \
	-o 'solar source sun 0 0 4 ${ Dx } ${ Dy } ${ Dz } 0.533' >> skies/suns.rad

xform -m black objects/testroom_Swall.rad objects/testroom.rad objects/ground.rad \
	| oconv materials/testroom.mat - objects/glazing.rad objects/venetianblind.rad \
		objects/glazing_bsdf.rad skies/suns.rad > octs/model_suns.oct

time rcontrib < data/photocells.pts -n $procs -I -ab 1 -ad 65536 -lw 1.52e-5 -dc 1 -dt 0 -dj 0 -st 1 -ss 0 -faf  \
	-e MF:6 -f reinhart.cal -b rbin -bn Nrbins -m solar \
	octs/model_suns.oct > matrices/directsun.dsmx

### Section 6.8 - Putting it all together
printf "\nCombining it all\n"
epw2wea skies/USA_CA_Oakland.Intl.AP.724930_TMY3.epw skies/OakLand.wea
gendaymtx -of skies/OakLand.wea > matrices/OakLand.smx
gendaymtx -of -d skies/OakLand.wea > matrices/OakLand_direct.smx
gendaymtx -5 -d -m 6 -of skies/OakLand.wea > matrices/OakLand_direct_m6.smx

time dctimestep -n 8760 -if matrices/viewmatrix.vmx bsdf/fullwindow.xml  \
	matrices/daylightmatrix.dmx matrices/OakLand.smx | \
	rcollate -h -oc 1 > i_3ph.txt

time dctimestep -n 8760 -if  matrices/viewmatrix_direct.vmx bsdf/fullwindow.xml  \
	matrices/daylightmatrix_direct.dmx matrices/OakLand_direct.smx | \
	rcollate -h -oc 1 > i_ds3ph.txt

time dctimestep -n 8760 -if matrices/directsun.dsmx matrices/OakLand_direct_m6.smx | \
	rcollate -h -oc 1 > i_ds5ph.txt

rlam i_3ph.txt i_ds3ph.txt i_ds5ph.txt | \
	rcalc -e 'r=$1-$4+$7;g=$2-$5+$8;b=$3-$6+$9' \
	-e '$1=179*(.265*r+.670*g+.065*b)' | \
	rcollate -h -fa1 -ic 8760 -t > illum.txt

printf "\nAll done with example 1!  look at illum.txt for the result.\n"


printf "\n\n\nDoing 5-phase simulation for rendering...\n"
### 7.1	View matrix (V)
printf "\nView Matrix...\n"
time vwrays -vf views/back.vf  -ff -x 500 -y 500 \
	| rcontrib `vwrays -vf views/back.vf  -x 500 -y 500 -d` -n $procs -ffc -fo -o viewpics/back_%03d.hdr \
		-f klems_int.cal -b kbinS -bn Nkbins -m viewsurf \
		-ab 10 -ad 65536 -lw 1.52e-5 octs/model_3ph.oct

### 7.2	Direct view matrix (Vd)	
printf "\nDirect View Matrix...\n"	
time vwrays -vf views/back.vf  -ff -x 500 -y 500 \
	| rcontrib `vwrays -vf views/back.vf  -x 500 -y 500 -d` -n $procs -ffc -fo -o viewpics_dir/back_%03d.hdr \
		-f klems_int.cal -b kbinS -bn Nkbins -m viewsurf \
		-ab 1 -ad 65536 -lw 1.52e-5 octs/model_3ph.oct

### 7.5	Direct sun coefficient matrix (Cds)
printf "\nDirect Coefficient Matrix...\n"
ulimit -n 9999
xform -m black objects/testroom_Swall.rad objects/testroom.rad objects/ground.rad | \
	oconv materials/testroom.mat - objects/venetianblind.rad > octs/model_nosuns.oct
time vwrays -c 4 -pj 1 -fa -vf views/back.vf -x 500 -y 500 | \
	rtrace -h- -opn -faa -ab 0 octs/model_nosuns.oct | \
	rcontrib `vwrays -vf views/back.vf -x 500 -y 500 -d` -n $procs -fac -fo -o viewpics_ds/back_%04d.hdr \
	-e MF:6 -f reinhart.cal -b rbin -bn Nrbins -m solar -c 4 -I -ab 1 -ad 100 -dt 0 -dc 1 -lw 1e-2 octs/model_suns.oct

oconv materials/testroom.mat objects/testroom_Swall.rad objects/testroom.rad \
	objects/ground.rad objects/glazing.rad objects/venetianblind.rad \
	objects/daymtxsurf.rad > octs/model_material.oct
time rpict -x 1000 -y 1000 -vf views/back.vf -ps 1 -pj 1 -av 0.31831 0.31831 0.31831 -aa 0 \
	octs/model_material.oct | pfilt -x /2 -y /2 -1 -e 1 > materialmap.hdr  

### 7.6	Putting it all together
printf "\nPutting it together...\n"
time dctimestep -n 8760 -if -o hourlypics/back_%04d.hdr viewpics/back_%03d.hdr \
	bsdf/fullwindow.xml matrices/daylightmatrix.dmx matrices/OakLand.smx 

time dctimestep -n 8760 -if -o hourlypics_dir/back_%04d.hdr viewpics_dir/back_%03d.hdr \
	bsdf/fullwindow.xml matrices/daylightmatrix_direct.dmx matrices/OakLand_direct.smx 

time dctimestep -n 8760 -if -o hourlypics_ds/back_%04d.hdr viewpics_ds/back_%04d.hdr \
	matrices/OakLand_direct_m6.smx

time for t in {1..8760} 
do ts=`printf %04d $t `
pcomb -e 'lo=li(1)-li(2)+li(3)*li(4)' -o hourlypics/back_${ts}.hdr -o hourlypics_dir/back_${ts}.hdr \
	-o hourlypics_ds/back_${ts}.hdr -o materialmap.hdr > hourlyresult/back_${ts}.hdr 
done
printf "\nAll Done with 5-phase Rendering sim\n"
pcond hourlyresult/back_0015.hdr | ximage &""")

falsestart_2 = LBFalseStartToggle(True)

# ----
# Create working folder
panel_9 = Panel("mkdir -p <proj>")
applyglobals = ApplyGlobals(Input=panel_9)  # -> Output, Pairs
execute_ssh_async_2 = ExecuteSSHAsync(SSHCommands=applyglobals.Output, Run=falsestart_2)  # -> Stdout, Stderr, Log, Pid, Ran

item = ListItem(List=entwine, Index=0, Wrap=True)
long = LongestList(ListA=item, ListB="blackMaterial", PaddingMode=2)  # -> ListA, ListB
concat_2 = Concatenate(FragmentA=graft, FragmentB="_black")
concat_3 = Concatenate(FragmentA=graft, FragmentB="_mat")

# ----
# window geometry
mesh2obj = MeshToObj(Mesh=mesh, Name="Windows", ModifierName=concat, Run=execute_ssh_async_2.Ran)  # -> ObjFiles, MapFile, Run
obj2rad = ObjToRad(ObjFiles=mesh2obj.ObjFiles, MapFile=mesh2obj.MapFile, Run=mesh2obj.Run)  # -> Status, RadFiles, Run

# ----
# Black Geometry
mesh2obj_2 = MeshToObj(Mesh=entwine, Name=concat_2, ModifierName=long.ListB, Run=execute_ssh_async_2.Ran)  # -> ObjFiles, MapFile, Run
obj2rad_2 = ObjToRad(ObjFiles=mesh2obj_2.ObjFiles, MapFile=mesh2obj_2.MapFile, Run=mesh2obj_2.Run)  # -> Status, RadFiles, Run

# ----
# Geometry
mesh2obj_3 = MeshToObj(Mesh=entwine, Name=graft, ModifierName=concat_3, Run=execute_ssh_async_2.Ran)  # -> ObjFiles, MapFile, Run
obj2rad_3 = ObjToRad(ObjFiles=mesh2obj_3.ObjFiles, MapFile=mesh2obj_3.MapFile, Run=mesh2obj_3.Run)  # -> Status, RadFiles, Run

# ----
# grid points
rectangle = Rectangle(Plane=PlaneXY(-194.7254335, -90.60693642, 0), XSize=Domain(-5, 500), YSize=Domain(-3, 300), Radius=0)  # -> Rectangle, Length
sdivide = DivideSurface(Surface=floor, UCount=10, VCount=20)  # -> Points, Normals, Parameters
panel_10 = Panel(sdivide.Parameters)
points2pts = PointsToPts(Points=flatten(sdivide.Points), Vectors=Vector(0, 0, 1), Name="points", Run=execute_ssh_async_2.Ran)  # -> PtsFile, Run
points = Text(points2pts.PtsFile)

panel_11 = Panel("""export PATH=$PATH.:/usr/local/radiance/bin
export RAYPATH=.:/usr/local/radiance/lib
objline "<proj>/<file>.rad" | meta2tga -x 1048 -y 1048 | ra_t8 -r > "<proj>/<file>.hdr"
normtiff "<proj>/<file>.hdr" "<proj>/<file>.tif"
convert "<proj>/<file>.tif" "<proj>/<file>.png"
echo "<proj>/<file>.png"
""")

# ----
# WEA file
# create WEA file
path = FilePath("C:\ladybug\NOR_OS_Alna.014870_TMYx.2004-2018\NOR_OS_Alna.014870_TMYx.2004-2018.epw")
upload = Upload(LocalFilePaths=path, Run=execute_ssh_async_2.Ran)  # -> Status, FilePaths, Run
rep = ReplaceText(Text=upload.FilePaths, Find=".epw", Replace=".wea", RecursiveReplace=False)
panel_12 = Panel("""in
out""")
applyglobals_2 = ApplyGlobals(Input="epw2wea <in> <out> 1>&2;echo <out>", AdditionalKeys=panel_12, AdditionalValues=[upload.FilePaths, rep])  # -> Output, Pairs
execute_ssh_async_3 = ExecuteSSHAsync(SSHCommands=applyglobals_2.Output, Run=upload.Run)  # -> Stdout, Stderr, Log, Pid, Ran
file_exists = Panel("[ -f <out> ] && echo \"1\" || echo \"0\"")
panel_13 = Panel(execute_ssh_async_3.Stderr)
panel_14 = Panel(execute_ssh_async_3.Stdout)
applyglobals_3 = ApplyGlobals(Input=file_exists, AdditionalKeys="out", AdditionalValues=execute_ssh_async_3.Stdout)  # -> Output, Pairs
execute_ssh_async_4 = ExecuteSSHAsync(SSHCommands=applyglobals_3.Output, Run=upload.Run)  # -> Stdout, Stderr, Log, Pid, Ran
wea_file = Text(execute_ssh_async_3.Stdout)

# ----
# export PATH=$PATH.:/usr/local/radiance/bin
# export RAYPATH=.:/usr/local/radiance/lib
# obj2rad -m /home/mss/simulation/mapping.map -f /home/mss/simulation/twoMeshes4.obj 2>&1 1>/home/mss/simulation/x.rad
# head /home/mss/simulation/x.rad
panel_15 = Panel("""export PATH=$PATH.:/usr/local/radiance/bin
export RAYPATH=.:/usr/local/radiance/lib
objline ~/simulation/twoMeshes5.rad | meta2tga -x 1048 -y 1048 | ra_t8 -r > ~/simulation/test.hdr
normtiff ~/simulation/test.hdr ~/simulation/test.tif
convert ~/simulation/test.tif ~/simulation/test.png
echo "C:\Users\mm1013\simulation\test.png"
""")

# ----
# Setup materials
panel_16 = Panel("""0.2
0.6""")
opaquegreymat = OpaqueGreyMat(Name=flatten(concat_3), Reflectance_0_1=panel_16, Specularity=0, Roughness=0)  # -> RadMaterials, RadMaterialList
entwine_2 = Entwine(Branch00=opaquegreymat.RadMaterials, Branch01="opaque_materials.rad", FlattenInputs=True)  # -> flatten(Result)
panel_17 = Panel("""mats
target""")
applyglobals_4 = ApplyGlobals(Input="echo \"<mats>\" > <proj>/<target>;echo \"<proj>/<target>\"", AdditionalKeys=panel_17, AdditionalValues=entwine_2)  # -> Output, Pairs
execute_ssh_async_5 = ExecuteSSHAsync(SSHCommands=applyglobals_4.Output, Run=obj2rad_3.Run)  # -> Stdout, Stderr, Log, Pid, Ran
opaque_mat = Text(execute_ssh_async_5.Stdout)
opaque_rad = Text(obj2rad_3.RadFiles)

# ----
# blackmaterials
panel_18 = Panel("0.0")
opaquegreymat_2 = OpaqueGreyMat(Name=flatten("blackMaterial"), Reflectance_0_1=panel_18, Specularity=0, Roughness=0)  # -> RadMaterials, RadMaterialList
panel_19 = Panel("echo \"<mats>\" >~/simulation/blackmats.mat;echo \"~/simulation/blackmats.mat\"")
rep_2 = ReplaceText(Text=panel_19, Find="<mats>", Replace=opaquegreymat_2.RadMaterials, RecursiveReplace=False)
execute_ssh_async_6 = ExecuteSSHAsync(SSHCommands=rep_2, Run=obj2rad_2.Run)  # -> Stdout, Stderr, Log, Pid, Ran
black_rad_files = Text(obj2rad_2.RadFiles)

glassmat = GlassMat(Name=concat, Transmittance_0_1="0.8")  # -> RadMaterials, RadMaterialList

# ----
# rad files (incl mats)
# Setup glass materials
panel_20 = Panel("echo \"<mats>\" > <proj>/<target>;echo \"<proj>/<target>\"")
panel_21 = Panel("""mats
target""")
entwine_3 = Entwine(Branch00=glassmat.RadMaterials, Branch01="glass_materials.rad", FlattenInputs=True)  # -> flatten(Result)
applyglobals_5 = ApplyGlobals(Input=panel_20, AdditionalKeys=panel_21, AdditionalValues=entwine_3)  # -> Output, Pairs
execute_ssh_async_7 = ExecuteSSHAsync(SSHCommands=applyglobals_5.Output, Run=obj2rad_3.Run)  # -> Stdout, Stderr, Log, Pid, Ran
window_mat = Text(execute_ssh_async_7.Stdout)
window_rad = Text(obj2rad.RadFiles)

overrides = ApplyOverrides(Input=panel_11, AdditionalKeys="file")  # -> Output, Pairs
falsestart_3 = LBFalseStartToggle(False)
execute_ssh_async_8 = ExecuteSSHAsync(SSHCommands=panel_15, Run=falsestart_3)  # -> Stdout, Stderr, Log, Pid, Ran
black_mat = Text(execute_ssh_async_6.Stdout)
imageviewer = LBImageViewer(ImagePath_=execute_ssh_async_8.Stdout, _scale_=1, DisableClickable=False, SaveImgWithCoords=False, scale=1)  # -> ImagePath, Values, GIF
panel_22 = Panel(execute_ssh_async_8.Stderr)

# ----
# create black octree
black_rad_files_2 = Text(black_rad_files)
window_mat_2 = Text(window_mat)
black_mat_2 = Text(black_mat)
window_rad_2 = Text(window_rad)
and = GateAnd(A=execute_ssh_async_7.Ran, B=execute_ssh_async_6.Ran)
panel_23 = Panel("oconv -f <rads> > ~/simulation/myscene_black.oct;echo ~/simulation/myscene_black.oct")
entwine_4 = Entwine(Branch00=window_mat_2, Branch01=window_rad_2, Branch02=black_mat_2, Branch03=black_rad_files_2, FlattenInputs=True)  # -> flatten(Result)
join = TextJoin(Text=flatten(entwine_4), Join=" ")
rep_3 = ReplaceText(Text=panel_23, Find="<rads>", Replace=join, RecursiveReplace=False)
execute_ssh_async_9 = ExecuteSSHAsync(SSHCommands=rep_3, Run=and)  # -> Stdout, Stderr, Log, Pid, Ran
panel_24 = Panel(execute_ssh_async_9.Stdout)
octree_black = Text(execute_ssh_async_9.Stdout)

# ----
# Create skyglow.rad
panel_25 = Panel("/home/mss/simulation/skyglow.rad")
panel_26 = Panel("""#@rfluxmtx u=+Y h=u
void glow groundglow
0
0
4 1 1 1 0

groundglow source ground
0
0
4 0 0 -1 180

#@rfluxmtx u=+Y h=r1
void glow skyglow
0
0
4 1 1 1 0

skyglow source skydome
0
0
4 0 0 1 180""")
panel_27 = Panel("""skyglow
target""")
applyglobals_6 = ApplyGlobals(Input="echo \"<skyglow>\" > <target>; echo <target>", AdditionalKeys=panel_27, AdditionalValues=[panel_26, panel_25])  # -> Output, Pairs
execute_ssh_async_10 = ExecuteSSHAsync(SSHCommands=applyglobals_6.Output, Run=execute_ssh_async_2.Ran)  # -> Stdout, Stderr, Log, Pid, Ran
applyglobals_7 = ApplyGlobals(Input="head <target>", AdditionalKeys=panel_27, AdditionalValues=[panel_26, panel_25])  # -> Output, Pairs
execute_ssh_async_11 = ExecuteSSHAsync(SSHCommands=applyglobals_7.Output, Run=execute_ssh_async_10.Ran)  # -> Stdout, Stderr, Log, Pid, Ran
panel_28 = Panel(execute_ssh_async_10.Stdout)
panel_29 = Panel(execute_ssh_async_11.Stdout)
skyglow = Text(execute_ssh_async_10.Stdout)

# ----
# Annual sky-matrix 145 patches
wea_file_2 = Text(wea_file)
# Skies and Skymatrices
panel_30 = Panel("gendaymtx -m 1 \"<wea>\" > <smx>;echo \"<smx>\"")
rep_4 = ReplaceText(Text=wea_file_2, Find=".wea", Replace=".smx", RecursiveReplace=False)
panel_31 = Panel("""wea
smx""")
applyglobals_8 = ApplyGlobals(Input=panel_30, AdditionalKeys=panel_31, AdditionalValues=[wea_file_2, rep_4])  # -> Output, Pairs
execute_ssh_async_12 = ExecuteSSHAsync(SSHCommands=applyglobals_8.Output, Run=execute_ssh_async_4.Ran)  # -> Stdout, Stderr, Log, Pid, Ran
panel_32 = Panel(execute_ssh_async_12.Stdout)

# ----
# Sun matrix with 5165 suns
wea_file_3 = Text(wea_file)
panel_33 = Panel("gendaymtx -5 0.533 -d -m 6 \"<wea>\" > <smx>;echo \"<smx>\"")
rep_5 = ReplaceText(Text=wea_file_3, Find=".wea", Replace="sunM6.smx", RecursiveReplace=False)
panel_34 = Panel("""wea
smx""")
applyglobals_9 = ApplyGlobals(Input=panel_33, AdditionalKeys=panel_34, AdditionalValues=[wea_file_3, rep_5])  # -> Output, Pairs
execute_ssh_async_13 = ExecuteSSHAsync(SSHCommands=applyglobals_9.Output, Run=execute_ssh_async_4.Ran)  # -> Stdout, Stderr, Log, Pid, Ran
panel_35 = Panel(execute_ssh_async_13.Stdout)

# ----
# Annual direct only daylight matrix with 145 patches
wea_file_4 = Text(wea_file)
rep_6 = ReplaceText(Text=wea_file_4, Find=".wea", Replace="d.smx", RecursiveReplace=False)
panel_36 = Panel("""wea
smx""")
applyglobals_10 = ApplyGlobals(
    Input="gendaymtx -m 1 -d \"<wea>\" > <smx>;echo \"<smx>\"",
    AdditionalKeys=panel_36,
    AdditionalValues=[wea_file_4, rep_6])  # -> Output, Pairs
execute_ssh_async_14 = ExecuteSSHAsync(SSHCommands=applyglobals_10.Output, Run=execute_ssh_async_4.Ran)  # -> Stdout, Stderr, Log, Pid, Ran
panel_37 = Panel(execute_ssh_async_14.Stdout)

m6_sky_mtx = Text(panel_35)
panel_38 = Panel("18")  # disabled
panel_39 = Panel("8")  # disabled
analysisperiod = LBAnalysisPeriod(start_month=1, start_day=1, start_hour=panel_39, end_hour=panel_38)  # -> period, hoys, dates; disabled; plug-in component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
panel_40 = Panel("C:\Users\mm1013\simulation\DDS_Total.ill")  # disabled
panel_41 = Panel("C:\Users\mm1013\simulation\points.pts")  # disabled
points_2 = Text(points)  # disabled
Z = UnitZ(Factor=1)  # disabled
pt = Point(flatten(sdivide.Points))  # disabled
panel_42 = Panel("C:\Users\mm1013\simulation\points.pts")  # disabled
long_2 = LongestList(ListA=pt, ListB=Z, PaddingMode=2)  # -> ListA, ListB; disabled
readannualresultsi = Honeybee_ReadAnnualResultI(
    illFilesAddress=panel_40,
    testPoints=simplify(long_2.ListA),
    ptsVectors=long_2.ListB,
    DLAIllumThresholds=300,
    runIt=False)  # -> DLA, UDLI_Less_100, UDLI_100_2000, UDLI_More_2000, CDA, sDA, annualProfiles, htmReport; disabled; plug-in component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
honeybee = Honeybee_Honeybee()  # -> Vviiiiiiiiiizzz; disabled; plug-in component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
toggle_2 = BooleanToggle(True)  # disabled
reload_analysisgrid = GhPythonScript(pts_file=panel_42, ill_file=panel_40, run=toggle_2)  # -> out, analysisGrid; inputs hoys: list; disabled
# ---------- reload_analysisgrid: Python ----------
"""
    Args:
        _pts_file: Path to a points (*.pts) file
        _ill_file: Path to an illuminance (*.ill) file
        _hoys: A list of hours of the year. This should be the same list as the
            one used to run the simulation earlier.
            
            If you ran an Annual Simulation (using the Annual Daylight, Annual
            Radiation, DC-Grid Based, 3P or 5P recipe), you should provide a
            list of integers from 0 to 8759. If you used smaller timesteps in
            your simulation (e.g. using 'hoys_' input in HoneybeePlus_SkyMatrix
            component), make sure you provide a list with appropriate matching
            timesteps.
            
            If you ran a Solar Access simulation, you could use the hoys output
            from LadybugPlus_SunPath component i.e. the same you provided for the
            Solar Access Recipe.
            
            If you ran a simulation using HoneybeePlus Grid Based Recipe, you
            should enter the same hoy as was used to create the sky.
            
            You can get this _hoys list from:
            (1) LadybugPlus_SunPath component
            (2) LadybugPlus_Analysis Period component
            (3) LadybugPlus_Calculate HOY component
            (4) Standard grasshopper components
        _gridMode_: 0 > load the values. (Default)
            1 > load values as binary. Any non-zero value will be 1. Useful for studies such as Solar Access a.k.a. Sunlight Hours.
            2 > load the values divided by mode number. Use this mode for daylight factor or radiation analysis
        _run: Set to True to load the AnalysisGrid
    Returns:
        analysisGrid: Outputs a analysis grid loaded with results. Connect this
             grid to standard honeybee[+] copmonents to get the values
"""

import rhinoscriptsyntax as rs
from honeybee_radiance.sensorgrid import SensorGrid
#from honeybee.radiance.analysisgrid import AnalysisGrid

if _run == True:


    if _gridMode_ == None:
        gmode = 0
    else:
        gmode = int(_gridMode_)

# first let's create an analysis grid from pts file
    analysisGrid = SensorGrid.from_file(_pts_file)
    

# now let's load the results
    #analysisGrid.set_values_from_file(_ill_file, hoys=_hoys, mode=gmode)
# ---------- end reload_analysisgrid ----------
readannualresultsii = Honeybee_ReadAnnualResultII(resultFilesAddress=panel_40, testPts=long_2.ListA, timeStep=1)  # -> readMe, lessThanRange, inTheRange, moreThanRange; disabled; plug-in component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
panel_43 = Panel("10")  # disabled
python = GhPythonScript(x=reload_analysisgrid.analysisGrid)  # -> out, a; disabled
# ---------- python: Python ----------
__author__ = "mm1013"
__version__ = "2022.04.06"

import rhinoscriptsyntax as rs

x.info_dict
# ---------- end python ----------
panel_44 = Panel("12")  # disabled
gradient = Gradient(
    LowerLimit=panel_44,
    UpperLimit=panel_43,
    Parameter=readannualresultsii.inTheRange,
    stops=[0: RGB(234, 38, 0), 0.25: RGB(234, 126, 0), 0.5: RGB(254, 244, 84), 0.75: RGB(173, 203, 249), 1: RGB(75, 107, 169)])  # disabled
bnd = Bounds(Numbers=readannualresultsii.inTheRange)  # disabled
pt_2 = Point(pt)  # disabled
panel_45 = Panel("~/simulation/points.pts2")  # disabled
panel_46 = Panel("file")  # disabled
panel_47 = Panel("[ -f <file> ] && echo \"1\" || echo \"0\"")  # disabled
falsestart_4 = LBFalseStartToggle(False)  # disabled
applyglobals_11 = ApplyGlobals(Input=panel_47, AdditionalKeys=panel_46, AdditionalValues=panel_45)  # -> Output, Pairs; disabled
preview = CustomPreview(Geometry=pt_2, Material=gradient)  # disabled
execute_ssh_async_15 = ExecuteSSHAsync(SSHCommands=applyglobals_11.Output, Run=falsestart_4)  # -> Stdout, Stderr, Log, Pid, Ran; disabled
panel_48 = Panel(execute_ssh_async_15.Stdout)  # disabled

# ----
# Setup globals
# And test them
panel_49 = Panel("""proj
cpus""")
panel_50 = Panel("""~/simulation/myproject
7""")
globals = SetupGlobals(Keys=panel_49, Values=panel_50)
panel_51 = Panel(globals)

applyglobals_12 = ApplyGlobals(Input="<proj>/testfile.fil")  # -> Output, Pairs

panel_52 = Panel(applyglobals_12.Output)

falsestart_5 = LBFalseStartToggle(False)

execute_ssh_async_16 = ExecuteSSHAsync(SSHCommands=["cat ~/.bashrc", "dwd | tee ~/simulation/log.txt"], Run=falsestart_5)  # -> Stdout, Stderr, Log, Pid, Ran

panel_53 = Panel(execute_ssh_async_16.Stdout)
panel_54 = Panel(execute_ssh_async_16.Log)
panel_55 = Panel(execute_ssh_async_16.Stderr)

# ----
# Check if ximage and other x-commands work.
# Must have Xlaunch running on windows with disabled access control
# Otherwise it will crash!
panel_56 = Panel("""export "DISPLAY=$(ip route list default | awk '{print $3}'):0"
export "LIBGL_ALWAYS_INDIRECT=1"
xclock""")
falsestart_6 = LBFalseStartToggle(True)

execute_ssh_async_17 = ExecuteSSHAsync(SSHCommands=panel_56, Run=falsestart_6)  # -> Stdout, Stderr, Log, Pid, Ran

panel_57 = Panel(execute_ssh_async_17.Stderr)

# ----
# Sun
# sun primitive
panel_58 = Panel("""export PATH=$PATH.:/usr/local/radiance/bin
export RAYPATH=.:/usr/local/radiance/lib
echo "void light solar 0 0 3 1e6 1e6 1e6" > <target>
echo "<target>"
""")

applyglobals_13 = ApplyGlobals(Input=panel_58, AdditionalKeys="target", AdditionalValues="~/simulation/suns.rad")  # -> Output, Pairs
panel_59 = Panel("""export PATH=$PATH.:/usr/local/radiance/bin
export RAYPATH=.:/usr/local/radiance/lib
cnt 5165 | rcalc -e MF:6 -f reinsrc.cal -e Rbin=recno -o 'solar source sun 0 0 4 ${Dx} ${Dy} ${Dz} 0.553' >> <target>
echo <target>""")

execute_ssh_async_18 = ExecuteSSHAsync(SSHCommands=applyglobals_13.Output, Run=execute_ssh_async_2.Ran)  # -> Stdout, Stderr, Log, Pid, Ran

# ----
# solar discs and modifiers for 5165 suns (=MF:6)
panel_60 = Panel("target")
applyglobals_14 = ApplyGlobals(Input=panel_59, AdditionalKeys=panel_60, AdditionalValues=execute_ssh_async_18.Stdout)  # -> Output, Pairs
execute_ssh_async_19 = ExecuteSSHAsync(SSHCommands=applyglobals_14.Output, Run=execute_ssh_async_18.Ran)  # -> Stdout, Stderr, Log, Pid, Ran

# ----
# create black octreeDDS
suns_material = Text(execute_ssh_async_18.Stdout)
black_rad_files_3 = Text(black_rad_files)
window_mat_3 = Text(window_mat)
window_rad_3 = Text(window_rad)
black_mat_3 = Text(black_mat)
mf6_suns = Text(execute_ssh_async_19.Stdout)
entwine_5 = Entwine(
    Branch00=window_mat_3,
    Branch01=window_rad_3,
    Branch02=black_mat_3,
    Branch03=black_rad_files_3,
    Branch04=suns_material,
    Branch05=mf6_suns,
    FlattenInputs=True)  # -> flatten(Result)
join_2 = TextJoin(Text=flatten(entwine_5), Join=" ")
panel_61 = Panel("""rads
target""")
applyglobals_15 = ApplyGlobals(
    Input="oconv -f <rads> > <target>;echo <target>",
    AdditionalKeys=panel_61,
    AdditionalValues=[join_2, "~/simulation/myscene_black_sunCoeffecientsDDS.oct"])  # -> Output, Pairs
execute_ssh_async_20 = ExecuteSSHAsync(SSHCommands=applyglobals_15.Output, Run=execute_ssh_async_19.Ran)  # -> Stdout, Stderr, Log, Pid, Ran
panel_62 = Panel(execute_ssh_async_20.Stdout)
octree_blackdds = Text(panel_62)

# ----
# create octree
window_mat_4 = Text(window_mat)
opaque_mat_2 = Text(opaque_mat)
opaque_rad_2 = Text(opaque_rad)
window_rad_4 = Text(window_rad)
and_2 = GateAnd(A=execute_ssh_async_7.Ran, B=execute_ssh_async_5.Ran)
# Octrees
panel_63 = Panel("oconv -f <rads> > ~/simulation/myscene.oct;echo ~/simulation/myscene.oct")

entwine_6 = Entwine(Branch00=window_mat_4, Branch01=window_rad_4, Branch02=opaque_mat_2, Branch03=opaque_rad_2, FlattenInputs=True)  # -> flatten(Result)

join_3 = TextJoin(Text=flatten(entwine_6), Join=" ")
rep_7 = ReplaceText(Text=panel_63, Find="<rads>", Replace=join_3, RecursiveReplace=False)
execute_ssh_async_21 = ExecuteSSHAsync(SSHCommands=rep_7, Run=and_2)  # -> Stdout, Stderr, Log, Pid, Ran
panel_64 = Panel(execute_ssh_async_21.Stdout)
octree = Text(execute_ssh_async_21.Stdout)

panel_65 = Panel(execute_ssh_async_21.Stderr)

# ----
# Generate daylight coefficients
panel_66 = Panel("/home/mss/simulation/dc_illum.mtx")
# NO GOOD METHOD (YET) OF MAKING SURE
# THESE 3 DONT RUN AT THE SAME TIME.
# 
# Unless we chain them (doing that as a temp fix)
# Raytracing (rfluxmtx)
panel_67 = Panel("""export PATH=$PATH.:/usr/local/radiance/bin
export RAYPATH=.:/usr/local/radiance/lib
rfluxmtx -I+ -y 100 -lw 0.0001 -ab 5 -ad 5000 -n <cpus> - <skyglow> -i <octree> < <points> > <target>;echo <target>""")
skyglow_2 = Text(skyglow)
octree_2 = Text(octree)
points_3 = Text(points)
panel_68 = Panel("""points
octree
skyglow
target""")
entwine_7 = Entwine(Branch00=points_3, Branch01=octree_2, Branch02=skyglow_2, Branch03=panel_66, FlattenInputs=True)  # -> flatten(Result)
and_3 = GateAnd(OctreeOk=execute_ssh_async_21.Ran, SkyglowOk=execute_ssh_async_10.Ran, PointsOk=points2pts.Run)
applyglobals_16 = ApplyGlobals(Input=panel_67, AdditionalKeys=panel_68, AdditionalValues=entwine_7)  # -> Output, Pairs
panel_69 = Panel(applyglobals_16.Output)
execute_ssh_async_22 = ExecuteSSHAsync(SSHCommands=applyglobals_16.Output, Run=and_3)  # -> Stdout, Stderr, Log, Pid, Ran
panel_70 = Panel(execute_ssh_async_22.Stdout)

# ----
# Generate daylight coefficients black (direct only)
panel_71 = Panel("/home/mss/simulation/dcd_illum.mtx")
panel_72 = Panel("""export PATH=$PATH.:/usr/local/radiance/bin
export RAYPATH=.:/usr/local/radiance/lib
rfluxmtx -I+ -y 100 -lw 0.0002 -ab 1 -ad 5000 -n <cpus> - <skyglow> -i <octree> < <points> > <target>;echo <target>""")
octree_black_2 = Text(octree_black)
skyglow_3 = Text(skyglow)
points_4 = Text(points)
panel_73 = Panel("""points
octree
skyglow
target""")
and_4 = GateAnd(octree_ok=execute_ssh_async_9.Ran, points_ok=points2pts.Run, ran_above=execute_ssh_async_22.Ran)
entwine_8 = Entwine(Branch00=points_4, Branch01=octree_black_2, Branch02=skyglow_3, Branch03=panel_71, FlattenInputs=True)  # -> flatten(Result)
applyglobals_17 = ApplyGlobals(Input=panel_72, AdditionalKeys=panel_73, AdditionalValues=entwine_8)  # -> Output, Pairs
execute_ssh_async_23 = ExecuteSSHAsync(SSHCommands=applyglobals_17.Output, Run=and_4)  # -> Stdout, Stderr, Log, Pid, Ran
panel_74 = Panel(applyglobals_17.Output)
panel_75 = Panel(execute_ssh_async_23.Stdout)

# ----
# Calculate illuminance sun coefficients for illuminance calculations
panel_76 = Panel("/home/mss/simulation/cdsDDS_illum.mtx")
# Raytracing suns (rcontrib)
panel_77 = Panel("""export PATH=$PATH.:/usr/local/radiance/bin
export RAYPATH=.:/usr/local/radiance/lib
rcontrib -I+ -ab 1 -y 100 -n <cpus> -ad 256 -lw 1.0e-3 -dc 1 -dt 0 -dj 0 -faf -e MF:6 -f reinhart.cal -b rbin -bn Nrbins -m solar <octree> < <points> > <target>
echo <target>""")
octree_blackdds_2 = Text(octree_blackdds)
points_5 = Text(points)
panel_78 = Panel("""points
octree
target""")
entwine_9 = Entwine(Branch00=points_5, Branch01=octree_blackdds_2, Branch02=panel_76, FlattenInputs=True)  # -> flatten(Result)
applyglobals_18 = ApplyGlobals(Input=panel_77, AdditionalKeys=panel_78, AdditionalValues=entwine_9)  # -> Output, Pairs
and_5 = GateAnd(octree_ok=execute_ssh_async_20.Ran, points_ok=points2pts.Run, ran_above=execute_ssh_async_23.Ran)
panel_79 = Panel(applyglobals_18.Output)
execute_ssh_async_24 = ExecuteSSHAsync(SSHCommands=applyglobals_18.Output, Run=and_5)  # -> Stdout, Stderr, Log, Pid, Ran
panel_80 = Panel(execute_ssh_async_24.Stdout)

panel_81 = Panel(execute_ssh_async_22.Stderr)

# ----
# + Results of direct sun coefficients (5165 sample sky)
panel_82 = Panel("/home/mss/simulation/annualR_CDS.ill")
panel_83 = Panel("""export PATH=$PATH.:/usr/local/radiance/bin
export RAYPATH=.:/usr/local/radiance/lib
dctimestep <dcillum> <skymtx> | rmtxop -fa -t -c 47.4 119.9 11.6 - > <target>;echo <target>""")
panel_84 = Panel("""dcillum
skymtx
target""")
entwine_10 = Entwine(Branch00=panel_80, Branch01=m6_sky_mtx, Branch02=panel_82, FlattenInputs=True)  # -> flatten(Result)
and_6 = GateAnd(B=execute_ssh_async_13.Ran)
applyglobals_19 = ApplyGlobals(Input=panel_83, AdditionalKeys=panel_84, AdditionalValues=entwine_10)  # -> Output, Pairs
execute_ssh_async_25 = ExecuteSSHAsync(SSHCommands=applyglobals_19.Output, Run=and_6)  # -> Stdout, Stderr, Log, Pid, Ran
panel_85 = Panel(applyglobals_19.Output)
panel_86 = Panel(execute_ssh_async_25.Stdout)

# ----
# - Results of daylight coefficients (direct from 145 sample sky)
panel_87 = Panel("/home/mss/simulation/annualR_DCD.ill")
panel_88 = Panel("""export PATH=$PATH.:/usr/local/radiance/bin
export RAYPATH=.:/usr/local/radiance/lib
dctimestep <dcillum> <skymtx> | rmtxop -fa -t -c 47.4 119.9 11.6 - > <target>;echo <target>""")
panel_89 = Panel("""dcillum
skymtx
target""")
entwine_11 = Entwine(Branch00=execute_ssh_async_23.Stdout, Branch01=execute_ssh_async_14.Stdout, Branch02=panel_87, FlattenInputs=True)  # -> flatten(Result)
and_7 = GateAnd(A=execute_ssh_async_14.Ran, B=execute_ssh_async_23.Ran)
applyglobals_20 = ApplyGlobals(Input=panel_88, AdditionalKeys=panel_89, AdditionalValues=entwine_11)  # -> Output, Pairs
execute_ssh_async_26 = ExecuteSSHAsync(SSHCommands=applyglobals_20.Output, Run=and_7)  # -> Stdout, Stderr, Log, Pid, Ran
panel_90 = Panel(applyglobals_20.Output)
panel_91 = Panel(execute_ssh_async_26.Stdout)

panel_92 = Panel("head <ill> -n 13;echo \" \";echo \"Number of lines\";wc -l <ill>")
applyglobals_21 = ApplyGlobals(Input=panel_92, AdditionalKeys="ill", AdditionalValues=execute_ssh_async_25.Stdout)  # -> Output, Pairs
execute_ssh_async_27 = ExecuteSSHAsync(SSHCommands=applyglobals_21.Output, Run=execute_ssh_async_25.Ran)  # -> Stdout, Stderr, Log, Pid, Ran
panel_93 = Panel(execute_ssh_async_27.Stdout)

panel_94 = Panel("head <ill> -n 13;echo \" \";echo \"Number of lines\";wc -l <ill>")
applyglobals_22 = ApplyGlobals(Input=panel_94, AdditionalKeys="ill", AdditionalValues=execute_ssh_async_26.Stdout)  # -> Output, Pairs
execute_ssh_async_28 = ExecuteSSHAsync(SSHCommands=applyglobals_22.Output, Run=execute_ssh_async_26.Ran)  # -> Stdout, Stderr, Log, Pid, Ran
panel_95 = Panel(execute_ssh_async_28.Stdout)

# ----
# Results of daylight coefficients
panel_96 = Panel("/home/mss/simulation/annualR_DC.ill")
# Getting results (dctimestep)
panel_97 = Panel("""export PATH=$PATH.:/usr/local/radiance/bin
export RAYPATH=.:/usr/local/radiance/lib
dctimestep <dcillum> <skymtx> | rmtxop -fa -t -c 47.4 119.9 11.6 - > <target>;echo <target>""")
panel_98 = Panel("""dcillum
skymtx
target""")
entwine_12 = Entwine(Branch00=execute_ssh_async_22.Stdout, Branch01=execute_ssh_async_12.Stdout, Branch02=panel_96, FlattenInputs=True)  # -> flatten(Result)
and_8 = GateAnd(A=execute_ssh_async_22.Ran, B=execute_ssh_async_12.Ran)
applyglobals_23 = ApplyGlobals(Input=panel_97, AdditionalKeys=panel_98, AdditionalValues=entwine_12)  # -> Output, Pairs

execute_ssh_async_29 = ExecuteSSHAsync(SSHCommands=applyglobals_23.Output, Run=and_8)  # -> Stdout, Stderr, Log, Pid, Ran

panel_99 = Panel(execute_ssh_async_29.Stdout)

# ----
# final step: Combine results
panel_100 = Panel("/home/mss/simulation/DDS_Total.ill")
panel_101 = Panel("""export PATH=$PATH.:/usr/local/radiance/bin
export RAYPATH=.:/usr/local/radiance/lib
rmtxop <DCannualR> + -s -1 <DCDannualR> + <CDSannualR> > <target>;echo <target>""")
panel_102 = Panel("""DCannualR
DCDannualR
CDSannualR
target""")
and_9 = GateAnd(A=execute_ssh_async_29.Ran, B=execute_ssh_async_26.Ran, C=execute_ssh_async_25.Ran)
entwine_13 = Entwine(
    Branch00=execute_ssh_async_29.Stdout,
    Branch01=execute_ssh_async_26.Stdout,
    Branch02=execute_ssh_async_25.Stdout,
    Branch03=panel_100,
    FlattenInputs=True)  # -> flatten(Result)
applyglobals_24 = ApplyGlobals(Input=panel_101, AdditionalKeys=panel_102, AdditionalValues=entwine_13)  # -> Output, Pairs
execute_ssh_async_30 = ExecuteSSHAsync(SSHCommands=applyglobals_24.Output, Run=and_9)  # -> Stdout, Stderr, Log, Pid, Ran

download = Download(LinuxFilePaths=execute_ssh_async_30.Stdout, Run=execute_ssh_async_30.Ran)  # -> Status, FilePaths, Run; disabled
panel_103 = Panel(execute_ssh_async_30.Stdout)  # disabled
reload_analysisgrid_2 = GhPythonScript(pts_file=panel_41, ill_file=panel_40, hoys=analysisperiod.hoys, run=execute_ssh_async_30.Ran)  # -> out, analysisGrid; inputs hoys: list; disabled
# ---------- reload_analysisgrid_2: Python ----------
"""
    Args:
        _pts_file: Path to a points (*.pts) file
        _ill_file: Path to an illuminance (*.ill) file
        _hoys: A list of hours of the year. This should be the same list as the
            one used to run the simulation earlier.
            
            If you ran an Annual Simulation (using the Annual Daylight, Annual
            Radiation, DC-Grid Based, 3P or 5P recipe), you should provide a
            list of integers from 0 to 8759. If you used smaller timesteps in
            your simulation (e.g. using 'hoys_' input in HoneybeePlus_SkyMatrix
            component), make sure you provide a list with appropriate matching
            timesteps.
            
            If you ran a Solar Access simulation, you could use the hoys output
            from LadybugPlus_SunPath component i.e. the same you provided for the
            Solar Access Recipe.
            
            If you ran a simulation using HoneybeePlus Grid Based Recipe, you
            should enter the same hoy as was used to create the sky.
            
            You can get this _hoys list from:
            (1) LadybugPlus_SunPath component
            (2) LadybugPlus_Analysis Period component
            (3) LadybugPlus_Calculate HOY component
            (4) Standard grasshopper components
        _gridMode_: 0 > load the values. (Default)
            1 > load values as binary. Any non-zero value will be 1. Useful for studies such as Solar Access a.k.a. Sunlight Hours.
            2 > load the values divided by mode number. Use this mode for daylight factor or radiation analysis
        _run: Set to True to load the AnalysisGrid
    Returns:
        analysisGrid: Outputs a analysis grid loaded with results. Connect this
             grid to standard honeybee[+] copmonents to get the values
"""

import rhinoscriptsyntax as rs
from honeybee_plus.radiance.analysisgrid import AnalysisGrid

if _run == True:


    if _gridMode_ == None:
        gmode = 0
    else:
        gmode = int(_gridMode_)

# first let's create an analysis grid from pts file
    analysisGrid = AnalysisGrid.from_file(_pts_file)

# now let's load the results
    analysisGrid.set_values_from_file(_ill_file, hoys=_hoys, mode=gmode)
# ---------- end reload_analysisgrid_2 ----------
annualmetrics = HBAnnualDaylightMetrics(results=execute_ssh_async_30.Stdout)  # -> report, DA, cDA, UDI, UDI_low, UDI_up; disabled; plug-in component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

panel_104 = Panel("head <ill> -n 13;echo \" \";echo \"Number of lines\";wc -l <ill>")
applyglobals_25 = ApplyGlobals(Input=panel_104, AdditionalKeys="ill", AdditionalValues=execute_ssh_async_29.Stdout)  # -> Output, Pairs

execute_ssh_async_31 = ExecuteSSHAsync(SSHCommands=applyglobals_25.Output, Run=execute_ssh_async_29.Ran)  # -> Stdout, Stderr, Log, Pid, Ran

panel_105 = Panel(execute_ssh_async_31.Stdout)
